vi "802.11 FPGA STA.gvi"   [LabVIEW Communications System Design Suite 2.0.1]
panel controls:
  "reg.host read.go rcvd 0": bool
  "reg.notify host.go rcvd 0": bool
  "reg.reset 0": bool
  "RF 0/Rx/Enable": bool
  "RF 0/Tx/Enable": bool
  "RF 1/Rx/Enable": bool
  "RF 1/Tx/Enable": bool
  "ATR State": enum{"Idle", "Rx", "Tx", "Duplex"} = "Idle"
  "Radio Control Destination": T1 = "Radio 0 Config"
  "lo lpf enable": bool
  "power enable": bool
  "mixer enable": bool
  "tx.configuration": T2 = {"power enable"=TRUE, "mixer enable"=TRUE, "gain"=0}
  "RX data source": T3 = "RF"
  "packet start sample index": u16
  "rearm packet start generator": bool
  "bypass synchronization": bool
  "reset MAC RX statistics": bool
  "noise coefficient": FXP(8.8) = 10
  "mute RX while TX active?": bool = TRUE
  "number of samples to capture": u16 = 1024
  "produce silent samples": bool
  "MPDU filter config": T7 = {"remove header"=TRUE, "block unsupported frame types"=TRUE, "block FCS errors"=TRUE, "block address mismatch"=TRUE, "block header recognize error"=TRUE}
  "power calibration offset": FXP(10.3)
  "CCA energy detect threshold": FXP(10.3) = -62
  "RF gain": FXP(10.3)
  "number of samples before trigger": u16
  "synchronization settings": T8 = {"maximal normalization threshold"=65536, "peak timing metric threshold"=0.5, "consecutive samples over threshold"=10, "valley timing metric threshold"=-0.5, "consecutive samples under threshold"=10, "autocorelation threshold"=0.5, "expected peak valley distance"=608, "maximum peak valley distance deviation"=64, "samples to shift frame start"=-32, "use static CFO?"=FALSE, "static CFO"=0}
  "trigger condition": T9 = "Immediate"
  "manual trigger": bool
  "AGC tresholds": T10
  "AGC timeout": i32 = 3500
  "enable AGC": bool
  "manual PhyTxStart.req": cluster{"TX vector": T11, "Valid": bool}
  "bypass MAC TX": bool
  "RX TX turnaround time": u32 = 24
  "reset MAC TX statistics": bool
  "suppress ACK": bool
  "ACK bandwidth": enum{"20 MHz", "40 MHz", "80 MHz"} = "20 MHz"
  "rx.reset": bool = TRUE
  "rx.output sample rate": UFXP(1.47)
  "rx.delay": FXP(0.16)
  "rx 0.frequency shift": FXP(0.48)
  "rx 0.phase": FXP(0.21)
  "rx 0.impairments": T13 = {"inline gain I"=-1, "inline gain Q"=0.999992370605, "cross gain I"=0.999992370605, "cross gain Q"=0, "pre-gain offset I"=0, "pre-gain offset Q"=-1, "post-gain offset I"=0, "post-gain offset Q"=0.999992370605}
  "rx.abort": bool
  "tx.abort": bool
  "tx.reset": bool = TRUE
  "tx.input sample rate": UFXP(1.47)
  "tx.delay": FXP(0.18)
  "tx 0.frequency shift": FXP(0.48)
  "tx 0.phase": FXP(0.21)
  "tx 0.impairments": T13 = {"inline gain I"=0.999992370605, "inline gain Q"=0.999992370605, "post-gain offset I"=0.999992370605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}
  "tx 0.gain": T14 = {"gain I"=1, "gain Q"=1}
  "rx 1.impairments": T13 = {"inline gain I"=-0.999992370605, "inline gain Q"=0.999992370605, "cross gain I"=-0.999992370605, "cross gain Q"=0, "pre-gain offset I"=-1, "pre-gain offset Q"=0, "post-gain offset I"=0, "post-gain offset Q"=0}
  "rx 1.frequency shift": FXP(0.48)
  "rx 1.phase": FXP(0.21)
  "tx 1.impairments": T13 = {"inline gain I"=0.999992370605, "inline gain Q"=0.999992370605, "post-gain offset I"=-1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}
  "tx 1.frequency shift": FXP(0.48)
  "tx 1.phase": FXP(0.21)
  "tx 1.gain": T14 = {"gain I"=1, "gain Q"=1}
  "rx 0.stream enable": bool
  "rx 1.stream enable": bool
  "tx 0.stream enable": bool
  "tx 1.stream enable": bool
  "Data clock cycles per tick (0.1us)": u16 = 20
  "Data clock cycles per OFDM symbol": u16 = 480
  "rx.rf channel": UFXP(1.0)
  "tx.rf channel": UFXP(1.0)
  "enable DC offset correction": bool = TRUE
  "data clock locked?": bool
  "format": enum{"a", "ac"} = "a"
  "channel selector": UFXP(2.0)
  "device MAC address": u8[6]
  "DC centered signal": bool = TRUE
  "daughterboard": "niUsrpRio Config v1 Host.lvlib__DB Types.gtype" = "sbx"
  "antenna configuration": "niUsrpRio Config v1 Host.lvlib__Antenna Configuration.gtype" = "TX1 RX1 transmits and RX2 receives"
  "spi address": u8 = 7
  "cpld enable": bool = TRUE
  "time to wait for decoding packet": u32
  "CW Max": u16
  "CW Min": u16
  "Fixed backoff?": bool
  "Exponential Backoff Ratio": UFXP(6.10)
  "Fixed backoff value": u16
  "Backoff: Fixed Backoff Value": "U16 Register Names Enum.gtype" = "CW Max"
  "Backoff: CW Max": "U16 Register Names Enum.gtype" = "CW Max"
  "Backoff: Exponential Backoff Ratio": "FXP 6.10 Register Names Enum.gtype" = "Default"
  "Backoff: CW Min": "U16 Register Names Enum.gtype" = "CW Max"
  "Backoff: Fixed Backoff?": "Boolean Register Names Enum.gtype" = "Default"
  "Set Backoff Done Pulse to False": bool
  "Piggyback: Piggyback Address": "MAC Address Register Names.gtype" = "Default"
  "Piggyback: Enable Piggyback": "Boolean Register Names Enum.gtype" = "Default"
  "Enable Piggyback": bool
  "Use RTR instead of Data?": bool
  "Input: chain table": u64[8]
  "Host queue length (packets)": u32
  "Queue threshold for contention": u32
  "packet size (bytes)": u32
  "reset permission to contend": bool
  "Qchain:DIFS after ACK done (manual)": bool
  "Qchain:Use manual for DIFS after ACK done?": bool
  "Qchain:DIFS in global clock ticks": u32 = 340
  "Queue threshold for withdrawal (packets)": u32
  "Use manual Qchain withdrawal?": bool
  "manual Qchain withdrawal": bool
  "Qchain:id increment": u8 = 2
  "time for starting tracking": u32
panel indicators:
  "reg.notify host.go 0": bool
  "reg.host read.data 0": cluster{"go": bool, "data": u32}
  "compensated CFO": FXP(0.48)
  "MAC RX statistics": T4
  "PhyRxStart.ind": T5
  "PhyRxEnd.ind": T6
  "T2H RX Data overflow": u16
  "T2H Constallation overflow": u16
  "T2H RX Bit Processing Output FIFO overflow": u16
  "T2H RX Power Spectrum overflow": u16
  "T2H Channel Estimation overflow": u16
  "last applied gain": UFXP(5.1)
  "RF input power at packet start": FXP(10.3)
  "signal power at packet start": FXP(10.3)
  "RF input power": FXP(10.3)
  "signal power": FXP(10.3)
  "out of range?": bool
  "MAC TX statistics": T12
  "PhyTxStart.req": cluster{"TX vector": T11, "Valid": bool}
  "PhyTxEnd.ind": cluster{"Valid": bool}
  "internal loopback FIFO overflow": u16
  "TX to RF FIFO overflow": u16
  "T2H TX Baseband FIFO overflow": u16
  "T2H TX Bit Processing Output FIFO overflow": u16
  "rx.samples processed": u32
  "rx.number of IQ data overflows": u64
  "rx.number of overflows": u32
  "tx.samples processed": u32
  "tx.underflows": u32
  "tx.number of IQ data overflows": u64
  "rx.dsp reset done": bool
  "tx.dsp reset done": bool
  "tx.state": "Stream Control State.gtype"
  "rx.state": "Stream Control State.gtype"
  "Timestamp": u32
  "DC average": CFXP(1.17)
  "CW and Backoff Indicators": T15
  "Qchain:data after sifs count": u32
  "enable piggyback register": u32
  "count piggyback": u32
  "Has been transferred?": bool
  "ID table": u8[8]
  "Chain Table": u64[8]
  "Is header?": bool
  "Order in Chain": u8
  "Head Mac Address": u8[6]
  "PiggyBack Address": u8[6]
  "Check if it is matching?": bool
  "Check the ID": u8
  "Index of Max ID": i32
  "Piggy": u64
  "authorized to contend?": bool
  "FPGA queue length": u32
  "Qchain:count DIFS after ACK done": u32
  "Qchain:count TX after backoff done": u32
  "Qchain:count CCA idle for DIFS time": u32
  "Qchain:DIFS count": u32
  "Qchain:state": T16
  "Qchain:count fast piggyback": u32
  "Qchain:count fast piggyback trigger": u32
types:
  T1 = enum{"Identification", "Board Config", "Global Config", "Radio 0 Config", "Radio 1 Config", "Synchronization", "Time", "Future Events"}
  T2 = cluster{"power enable": bool, "mixer enable": bool, "gain": u8}
  T3 = enum{"RF", "BB Data From Host", "Internal Loopback"}
  T4 = cluster{"number of frames detected": u32, "number of subframes received": u32, "number of valid subframes received": u32, "number of ACKs received": u32, "valid": bool}
  T5 = cluster{"Format": enum{"a", "ac"}, "Bandwidth": enum{"20 MHz", "40 MHz", "80 MHz"}, "PSDU Length": u32, "MCS": UFXP(4.0), "valid": bool}
  T6 = cluster{"Format Violation": bool, "Timing valid": bool, "Timing value": u32, "valid": bool}
  T7 = cluster{"remove header": bool, "block unsupported frame types": bool, "block FCS errors": bool, "block address mismatch": bool, "block header recognize error": bool}
  T8 = cluster{"maximal normalization threshold": UFXP(19.15), "peak timing metric threshold": FXP(2.6), "consecutive samples over threshold": u8, "valley timing metric threshold": FXP(2.6), "consecutive samples under threshold": u8, "autocorelation threshold": UFXP(2.14), "expected peak valley distance": u16, "maximum peak valley distance deviation": u8, "samples to shift frame start": i8, "use static CFO?": bool, "static CFO": FXP(0.48)}
  T9 = enum{"Immediate", "RX Packet Start", "TX Paket Start", "CCA energy detected"}
  T10 = cluster{"AGC active threshold": FXP(10.3), "AGC threshold 1": FXP(10.3), "AGC threshold 2": FXP(10.3), "AGC threshold 3": FXP(10.3)}
  T11 = cluster{"format": enum{"a", "ac"}, "bandwidth": enum{"20 MHz", "40 MHz", "80 MHz"}, "length": u32, "MCS": UFXP(4.0), "TX power level": UFXP(4.0), "Scrambler seed": UFXP(7.0)}
  T12 = cluster{"number of TX after SIFS requests detected": u32, "number of TX after SIFS requests completed": u32, "number of TX after backoff requests detected": u32, "number of TX after backoff requests completed": u32}
  T13 = cluster{"inline gain I": FXP(1.17), "inline gain Q": FXP(1.17), "cross gain I": FXP(1.17), "cross gain Q": FXP(1.17), "pre-gain offset I": FXP(1.17), "pre-gain offset Q": FXP(1.17), "post-gain offset I": FXP(1.17), "post-gain offset Q": FXP(1.17)}
  T14 = cluster{"gain I": FXP(3.21), "gain Q": FXP(3.21)}
  "Stream Control State.gtype" = enum{"Idle", "Active"}
  "niUsrpRio Config v1 Host.lvlib__DB Types.gtype" = enum{"sbx", "cbx", "wbx", "unknown", "ubx"}
  "niUsrpRio Config v1 Host.lvlib__Antenna Configuration.gtype" = enum{"TX1 RX1 transmits and RX2 receives", "TX1 RX1 receives and RX2 is unused"}
  T15 = cluster{"CW": u16, "Last CWs": u16[30], "Last Backoffs": u16[30], "Last Random Numbers": UFXP(0.16)[30]}
  "U16 Register Names Enum.gtype" = enum{"Default", "CW Max", "CW Min", "Fixed Backoff Value", "Backoff"}
  "FXP 6.10 Register Names Enum.gtype" = enum{"Default", "Exponential Backoff Ratio"}
  "Boolean Register Names Enum.gtype" = enum{"Default", "Fixed Backoff?", "Enable Piggyback?"}
  "MAC Address Register Names.gtype" = enum{"Default", "Piggyback MAC Address"}
  T16 = enum{"\"First time into the chain\"", "\"First time to update the id table\"", "\"Update the id table again\"", "\"Withdraw from Qchain and reset Qchain ID\""}
  "Cluster Constant.gtype" = cluster{"CW Max Reg": RegisterDataType<u16>, "CW Min Reg": RegisterDataType<u16>, "Fixed Backoff Value Reg": RegisterDataType<u16>, "Backoff": RegisterDataType<u16>, "Exponential Backoff Ratio Reg": RegisterDataType<UFXP(6.10)>, "Fixed Backoff Reg": RegisterDataType<bool>, "U16 Default": RegisterDataType<u16>, "FXP <6.10> Default": RegisterDataType<UFXP(6.10)>, "Boolean Default": RegisterDataType<bool>, "Has been transferred?": RegisterDataType<bool>, "If is the header?": RegisterDataType<bool>}
  T17 = cluster{"MPDU subtype": enum{"ACK"}, "destination MAC address": u8[6], "valid": bool}
  T18 = cluster{"CCA energy detection busy": u8, "CCA signal detection busy": bool, "frame timing valid": bool, "frame timing value": u32, "frame timing use DIFS": bool}
  T19 = cluster{"5 MHz": bool, "10 MHz": bool, "20 MHz": bool, "40 MHz": bool, "80 Mhz": bool, "160 MHz": bool}
  T20 = cluster{"format": enum{"a", "ac"}, "channel selector": UFXP(2.0), "device MAC address": u8[6], "DC centered signal": bool, "supported bandwidths": T19}
  T21 = cluster{"global timestamp": RegisterDataType<u32>, "OFDM symbol pulse": RegisterDataType<bool>, "TX active": RegisterDataType<bool>, "channel state indication": RegisterDataType<T18>, "MPDU generation request": RegisterDataType<T17>, "shared properties": RegisterDataType<T20>}
  T22 = cluster{"CCA energy detection busy": u8, "CCA signal detection busy": bool}
  T23 = enum{"Idle", "Wait for second measurement", "AGC active", "Gain locked"}
  T24 = cluster{"trigger gain setting": bool, "gain": UFXP(5.1)}
  "802.11 PHY-SAP.gtype" = cluster{"PSDU (RX)": any, "PSDU (TX)": any, "CCA detection": RegisterDataType<T22>, "PhyRxStart.req": HandshakeDataType<T5>, "PhyRxEnd.ind": HandshakeDataType<T6>, "channel state indication": HandshakeDataType<T18>, "PhyTxStart.req": HandshakeDataType<cluster{"TX vector": T11, "Valid": bool}>, "PhyTxEnd.ind": HandshakeDataType<cluster{"Valid": bool}>, "PHY RX AGC state indication": HandshakeDataType<cluster{"AGC state": T23, "AGC enabled": bool}>, "PHY RX Gain change indication": HandshakeDataType<T24>}
  T25 = cluster{"RF to RX FIFO": any, "internal loopback FIFO": any, "TX to RF FIFO": any, "Gain Settings FIFO": any}
  T26 = cluster{"output sample rate": UFXP(1.47), "delay": FXP(0.16), "frequency shift": FXP(0.48), "impairments": T13, "phase": FXP(0.21)}
  T27 = cluster{"frequency shift": FXP(0.48), "impairments": T13, "phase": FXP(0.21), "input sample rate": UFXP(1.47), "gain": T14, "delay": FXP(0.18)}
diagram:
  Register Create(initial value=1024) -> (reference out=w1)
  Register Create(initial value=8) -> (reference out=w2)
  Register Create(initial value=4) -> (reference out=w3)
  Register Create(initial value=0) -> (reference out=w4)
  Register Create(initial value=0) -> (reference out=w5)
  Register Create(initial value=FALSE) -> (reference out=w6)
  Register Create(initial value=0) -> (reference out=w7)
  Register Create(initial value=0) -> (reference out=w8)
  Register Create(initial value=FALSE) -> (reference out=w9)
  Register Create(initial value=FALSE) -> (reference out=w10)
  Register Create(initial value=FALSE) -> (reference out=w11)
  Property Node(instance in="Cluster Constant.gtype" {all zero or empty}, "CW Max Reg"=w1, "CW Min Reg"=w2, "Fixed Backoff Value Reg"=w3, "Backoff"=w4, "Exponential Backoff Ratio Reg"=w5, "Fixed Backoff Reg"=w6, "U16 Default"=w7, "FXP <6.10> Default"=w8, "Boolean Default"=w9, "Has been transferred?"=w10, "If is the header?"=w11) -> (instance out=w12)
  Register Create(initial value=0) -> (reference out=w13)
  Register Create(initial value=FALSE) -> (reference out=w14)
  w15 = T17 {"MPDU subtype"="ACK", "destination MAC address"=[0, 0, 0, 0, 0, 0], "valid"=FALSE}
  Register Create(initial value=w15) -> (reference out=w16)
  Register Create(initial value=FALSE) -> (reference out=w17)
  Register Create(initial value=T18 {all zero or empty}) -> (reference out=w18)
  w19 = T20 {"format"="a", "channel selector"=0, "device MAC address"=[0, 0, 0, 0, 0, 0], "DC centered signal"=FALSE, "supported bandwidths"={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}}
  Register Create(initial value=w19) -> (reference out=w20)
  Property Node(instance in=T21 {all zero or empty}, "global timestamp"=w13, "MPDU generation request"=w16, "channel state indication"=w18, "TX active"=w17, "OFDM symbol pulse"=w14, "shared properties"=w20) -> (instance out=w21)
  FIFO Create(data type=u8 0) -> (reference out=w22)
  FIFO Create(data type=u8 0) -> (reference out=w23)
  Register Create(initial value=T22 {all zero or empty}) -> (reference out=w24)
  Handshake Create(data type=T5 {all zero or empty}) -> (reference out=w25)
  Handshake Create(data type=T6 {all zero or empty}) -> (reference out=w26)
  Handshake Create(data type=T18 {all zero or empty}) -> (reference out=w27)
  Handshake Create(data type=cluster{"TX vector": T11, "Valid": bool} {all zero or empty}) -> (reference out=w28)
  Handshake Create(data type=cluster{"Valid": bool} {all zero or empty}) -> (reference out=w29)
  w30 = cluster{"AGC state": T23, "AGC enabled": bool} {all zero or empty}
  Handshake Create(data type=w30) -> (reference out=w31)
  Handshake Create(data type=T24 {all zero or empty}) -> (reference out=w32)
  Property Node(instance in="802.11 PHY-SAP.gtype" {all zero or empty}, "PSDU (RX)"=w22, "PSDU (TX)"=w23, "CCA detection"=w24, "PhyRxStart.req"=w25, "PhyRxEnd.ind"=w26, "channel state indication"=w27, "PhyTxStart.req"=w28, "PhyTxEnd.ind"=w29, "PHY RX AGC state indication"=w31, "PHY RX Gain change indication"=w32) -> (instance out=w33)
  clock-driven loop (clock = "802.11 AFW Resources.grsc\\MACSLOW") (after w12) forever {
    call "802.11 PHY-SAP Read MAC.gcdl"(PHY-SAP=w33) -> (CCA detection=w34, PSDU=w35, PSDU valid=w36, PhyRxStart.req=w37, PhyTxEnd.ind=w38, PhyRxEnd.ind=w39, PHY RX AGC state indication=w40, PHY RX Gain change indication=w41)
    Property Node(instance in=w21) -> ("shared properties"=w42, "global timestamp"=w43, "channel state indication"=w44)
    Register Read(reference in=w43) -> (data=w45)
    # w34: CCA detection
    call "Piggyback.gcdl"(Piggyback: Piggyback Address=$"Piggyback: Piggyback Address", Piggyback: Enable Piggyback=$"Piggyback: Enable Piggyback") -> (Piggyback Address=w46, Piggyback Enable?=w47)
    Property Node(instance in=w37) -> ("valid"=w48)
    Feedback Node(enable?=w48, initial value=u8[6] default, input=w49) -> w50
    Feedback Node(input=w51) -> w52
    Property Node(instance in="802.11 AFW Resources.grsc\\H2T TX Data") -> ("used elements"=w53)
    call "manage Qchain withdrawal.gcdl"(Host queue length (packets)=$"Host queue length (packets)", FPGA queue length (bytes)=w53, Queue threshold for withdrawal (packets)=$"Queue threshold for withdrawal (packets)", packet size (bytes)=$"packet size (bytes)", Use manual Qchain withdrawal?=$"Use manual Qchain withdrawal?", manual Qchain withdrawal=$"manual Qchain withdrawal") -> (Qchain withdrawal=w54)
    call "802.11 MAC RX.gcdl"(PSDU=w35, input valid=w36, PHY RX start indication=w37, PHY RX end indication=w39, PHY CCA timing indication=w34, reset MAC RX statistics=$"reset MAC RX statistics", device MAC address=w50, MPDU filter config=$"MPDU filter config", Enable Piggyback=w47, piggyback MAC address=w46, Qchain:DIFS after ACK done=w52, global clock counter=w45, Input: chain table=$"Input: chain table", Qchain:DIFS in global clock ticks=$"Qchain:DIFS in global clock ticks", Qchain withdrawal?=w54, Qchain:id increment=$"Qchain:id increment") -> (MAC RX statistics=w55, channel state indication=w56, ICP SDU=w57, output valid=w58, MPDU generation request=w59, ACK Received Pulse=w60, Piggyback?=w61, Qchain:count DIFS after ACK done=w62, Qchain:state=w63, Qchain:count fast piggyback=w64, Qchain:count fast piggyback trigger=w65)
    $"Qchain:count DIFS after ACK done" <- w62
    $"Qchain:state" <- w63
    call "802.11 RX Data Sink.gcdl"(ICP SDU=w57, input valid=w58, FIFO reference="802.11 AFW Resources.grsc\\T2H RX Data") -> (FIFO overflow count=w66)
    $"T2H RX Data overflow" <- w66
    # w59: MPDU request
    Register Write(data=w56, reference in=w44) -> (reference out=w67)
    # w45: global time reference
    Register Read(reference in=w67) -> (data=w68)
    Register Read(reference in=w42) -> (data=w69)
    # w33: PHY SAP
    Property Node(instance in=w69) -> ("format"=w70, "device MAC address"=w49)
    # w67: channel state indication
    Feedback Node(input=w71) -> w72
    # w73: TX Data after SIFS
    call "802.11 Prepare ACK.gcdl"(format=w70, bandwidth=$"ACK bandwidth", MPDU generation request=w59, MAC ready=w72, suppress=$"suppress ACK") -> (MPDU block=w74, output valid=w75, TX after SIFS request=w76, TX Data After SIFS=w73)
    Register Read(reference in="802.11 AFW Resources.grsc\\Backoff") -> (data=w77)
    call "manage permission to contend.gcdl"(Host queue length (packets)=$"Host queue length (packets)", FPGA queue length (bytes)=w53, Queue threshold for contention (packets)=$"Queue threshold for contention", packet size (bytes)=$"packet size (bytes)", manual reset permission to contend=$"reset permission to contend", Qchain withdrawal pulse=w54) -> (authorized to contend?=w78)
    Feedback Node(input=w79) -> w80
    call "802.11 TX Data Source.gcdl"(ready for output=w80, H2T TX Data="802.11 AFW Resources.grsc\\H2T TX Data", bypass MAC TX=$"bypass MAC TX") -> (ICP data=w81, output valid=w82, elements available=w83)
    Feedback Node(input=w84) -> w85
    Feedback Node(input=w86) -> w87
    call "802.11 Prepare MPDU.gcdl"(ICP=w81, input valid=w82, elements available=w83, MAC ready for input=w85, TX status indication=w87, backoff value=w77, Use RTR instead of Data?=$"Use RTR instead of Data?", authorized to contend?=w78) -> (MPDU block=w88, ready for input=w79, output valid=w89, TX after backoff request=w90)
    Logical Or(w74, w88) -> w91
    Logical Or(w75, w89) -> w92
    Feedback Node(input=w93) -> w94
    call "802.11 MAC TX.gcdl"(TX after backoff request=w90, TX after SIFS request=w76, channel state indication=w68, global clock value=w45, RX TX turnaround time in global clock ticks=$"RX TX turnaround time", PSDU data ready for input=w94, PHY TX end indication=w38, MPDU block=w91, input valid=w92, reset MAC TX statistics=$"reset MAC TX statistics", Set Backoff Done Pulse to False=$"Set Backoff Done Pulse to False", TX Data After SIFS=w73, time for starting tracking=$"time for starting tracking") -> (MPDU=w95, output valid=w96, PHY TX start request=w97, TX after SIFS data ready for input=w71, TX after backoff data ready for input=w84, TX status indication=w86, MAC TX statistics=w98, TX after backoff done=w99, Qchain:data after sifs count=w100, Qchain:count TX after backoff done=w101, Qchain:DIFS done pulse=w102, Qchain:DIFS count=w103)
    call "802.11 TX MAC Bypass.gcdl"(ready for output=w94, TX data FIFO reference="802.11 AFW Resources.grsc\\H2T TX Data", bypass MAC TX=$"bypass MAC TX", manual PhyTxStart.req=$"manual PhyTxStart.req", MPDU=w95, input valid=w96, request in=w97) -> (PSDU=w104, output valid=w105, request out=w106)
    call "802.11 PHY-SAP Write MAC.gcdl"(PHY-SAP=w33, PhyTxStart.req=w106, PSDU=w104, PSDU valid=w105, channel state indication=w56) -> (PSDU TX ready for input=w93)
    $"MAC RX statistics" <- w55
    # w54: Qchain withdrawal?
    Feedback Node(input=w99) -> w107
    call "Check ACK Received.gcdl"(ACK Received Pulse In=w60, TX after backoff done=w107, time to wait for decoding packet=$"time to wait for decoding packet", global clock counter=w45) -> (ACK Received out=w108, valid?=w109)
    FIFO Write(Control Protocol Input=w109, data=w108, reference in="802.11 AFW Resources.grsc\\ACK Received FIFO")
    call "niInstr Basic Elements v1 FPGA.lvlib__Count Up U32.gcdl"(increment=w61) -> (count out=w110)
    $"count piggyback" <- w110
    $"MAC TX statistics" <- w98
    $"Qchain:DIFS count" <- w103
    $"Qchain:data after sifs count" <- w100
    $"Qchain:count TX after backoff done" <- w101
    $"FPGA queue length" <- w53
    call "niInstr Basic Elements v1 FPGA.lvlib__Count Up U32.gcdl"(increment=w47) -> (count out=w111)
    # w37: PHY RX start indication
    # w39: PHY RX end indication
    # w41: PHY RX Gain change indication
    $"enable piggyback register" <- w111
    # w40: PHY RX AGC state indication
    call "802.11 Write RX Events.gcdl"(global timestamp=w45, PHY RX start indication=w37, PHY RX end indication=w39, MAC channel state indication=w56, PHY CCA timing indication=w34, T2H FIFO reference="802.11 AFW Resources.grsc\\T2H Events", PHY RX Gain change indication=w41, PHY RX AGC state indication=w40)
    call "Track CCA Busy.gcdl"(global clock counter=w45)
    call "802.11 Capture PHY TX Indications.gcdl"(PHY TX end indication in=w38, PHY TX start request in=w106) -> (PHY TX start request out=w112, PHY TX end indication out=w113)
    $"PhyTxStart.req" <- w112
    $"authorized to contend?" <- w78
    $"PhyTxEnd.ind" <- w113
    call "802.11 Write TX Events.gcdl"(global time reference=w45, PHY TX end indication=w38, PHY TX start request=w106, TX status indication=w86, T2H FIFO reference="802.11 AFW Resources.grsc\\T2H Events")
    # w38: PhyTxEnd.ind
    call "Reset to next Chain.gcdl"(TX after backoff done=w107, slot M2 end pulse=w102, Use manual for DIFS after ACK done?=$"Qchain:Use manual for DIFS after ACK done?", global clock counter=w45, DIFS after ACK done (manual)=$"Qchain:DIFS after ACK done (manual)", Qchain:DIFS in global clock ticks=$"Qchain:DIFS in global clock ticks") -> (DIFS after ACK done=w51, count CCA idle for DIFS time=w114)
    $"Qchain:count CCA idle for DIFS time" <- w114
    $"Qchain:count fast piggyback" <- w64
    $"Qchain:count fast piggyback trigger" <- w65
    call "Backoff Block.gcdl"(Backoff: CW Max=$"Backoff: CW Max", Backoff: Exponential Backoff Ratio=$"Backoff: Exponential Backoff Ratio", Backoff: CW Min=$"Backoff: CW Min", Backoff: Fixed Backoff Value=$"Backoff: Fixed Backoff Value", Backoff: Fixed Backoff?=$"Backoff: Fixed Backoff?") -> (CW and Backoff Indicators=w115)
    $"CW and Backoff Indicators" <- w115
    Register Read(reference in="802.11 AFW Resources.grsc\\Has been transferred?") -> (data=w116)
    $"Has been transferred?" <- w116
    Register Read(reference in="802.11 AFW Resources.grsc\\Piggy") -> (data=w117)
    $Piggy <- w117
    # w102: DIFS done pulse
    Register Read(reference in="802.11 AFW Resources.grsc\\Head Mac Address") -> (data=w118)
    $"Head Mac Address" <- w118
    Register Read(reference in="802.11 AFW Resources.grsc\\ID Table") -> (data=w119)
    $"ID table" <- w119
    Register Write(data=$"Input: chain table", reference in="802.11 AFW Resources.grsc\\Chain Table")
    Register Write(data=$"Fixed backoff?", reference in="802.11 AFW Resources.grsc\\Fixed Backoff?")
    Register Write(data=$"CW Max", reference in="802.11 AFW Resources.grsc\\CW Max")
    Register Write(data=$"Exponential Backoff Ratio", reference in="802.11 AFW Resources.grsc\\Exponential Backoff Ratio")
    Register Read(reference in="802.11 AFW Resources.grsc\\Piggyback Address") -> (data=w120)
    $"PiggyBack Address" <- w120
    Register Write(data=$"CW Min", reference in="802.11 AFW Resources.grsc\\CW Min")
    Register Read(reference in="802.11 AFW Resources.grsc\\Chain Table") -> (data=w121)
    $"Chain Table" <- w121
    Register Write(data=$"Enable Piggyback", reference in="802.11 AFW Resources.grsc\\Enable Piggyback?")
    Register Write(data=$"Fixed backoff value", reference in="802.11 AFW Resources.grsc\\Fixed Backoff Value")
    Register Read(reference in="802.11 AFW Resources.grsc\\Check if it is matching?") -> (data=w122)
    $"Check if it is matching?" <- w122
    Register Read(reference in="802.11 AFW Resources.grsc\\Order ID in chain") -> (data=w123)
    $"Order in Chain" <- w123
    call "check if is the head of chain.gcdl"(Order in the Chain=w123) -> (Is header?=w124)
    $"Is header?" <- w124
    Register Read(reference in="802.11 AFW Resources.grsc\\Check the ID") -> (data=w125)
    $"Check the ID" <- w125
    Register Read(reference in="802.11 AFW Resources.grsc\\Max ID") -> (data=w126)
    $"Index of Max ID" <- w126
  }
  FIFO Create(data type=CFXP(3.13) 0+0i, depth=17) -> (reference out=w127)
  FIFO Create(data type=CFXP(3.13) 0+0i, depth=1025) -> (reference out=w128)
  FIFO Create(data type=CFXP(3.13) 0+0i, depth=1025) -> (reference out=w129)
  FIFO Create(data type=UFXP(5.1) 0, depth=17) -> (reference out=w130)
  Property Node(instance in=T25 {all zero or empty}, "RF to RX FIFO"=w127, "internal loopback FIFO"=w128, "TX to RF FIFO"=w129, "Gain Settings FIFO"=w130) -> (instance out=w131)
  clock-driven loop (clock = "802.11 AFW Resources.grsc\\PHY") forever {
    Property Node(instance in=w21) -> ("global timestamp"=w132, "shared properties"=w133, "TX active"=w134, "OFDM symbol pulse"=w135)
    Register Read(reference in=w132) -> (data=w136)
    Property Node(instance in=w131) -> ("RF to RX FIFO"=w137, "internal loopback FIFO"=w138, "TX to RF FIFO"=w139, "Gain Settings FIFO"=w140)
    Register Read(reference in=w135) -> (data=w141, reference out=w142)
    Register Read(reference in=w133) -> (data=w143)
    # w141: Symbol trigger
    Property Node(instance in=w143) -> ("supported bandwidths"=w144, "DC centered signal"=w145, "channel selector"=w146)
    Feedback Node(input=w147) -> w148
    call "802.11 PHY-SAP Read PHY.gcdl"(PHY-SAP=w33, ready for output=w148) -> (PSDU=w149, PSDU valid=w150, PhyTxStart.req=w151)
    call "niInstr Basic Elements v1 FPGA.lvlib__Detect Rising Edge.gcdl"(signal=w141) -> (edge detected=w152)
    call "802.11 PHY TX Request Handler.gcdl"(symbol trigger in=w152, PhyTxStart.req=w151, supported bandwidths=w144) -> (symbol index=w153, symbol trigger out=w154, start of packet=w155, TX vector out=w156, PhyTxEnd.ind=w157, TX active=w158)
    Register Write(data=w158, reference in=w134) -> (reference out=w159)
    call "802.11 RX Data Source.gcdl"(RX data source=$"RX data source", mute RX while TX active?=$"mute RX while TX active?", TX active register=w159, RF to RX FIFO=w137, internal loopback FIFO=w138, OFDM symbol trigger register=w142, produce silent samples=$"produce silent samples", H2T FIFO="802.11 AFW Resources.grsc\\H2T RX Baseband") -> (sample=w160, output valid=w161)
    call "802.11 Signal Filter.gcdl"(sample in=w160, input valid=w161, configuration=w143) -> (20MHz sample out=w162, output valid=w163, 40MHz sample out=w164, 80MHz sample out=w165)
    Feedback Node(input=w166) -> w167
    call "802.11 Synchronization.gcdl"(bypass synchronization=$"bypass synchronization", rearm packet start generator=$"rearm packet start generator", packet start sample index=$"packet start sample index", synchronization settings=$"synchronization settings", rearm sychronization=w167, sample in=w160, input valid=w161, filtered sample=w162, filtered sample valid=w163) -> (sample out=w168, output valid=w169, packet start=w170, compensated CFO=w171, CCA signal detected=w172)
    w173 = T20 {"format"="a", "channel selector"=0, "device MAC address"=[0, 0, 0, 0, 0, 0], "DC centered signal"=FALSE, "supported bandwidths"={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}}
    Feedback Node(enable?=w170, initial value=w173, input=w143) -> w174
    Property Node(instance in=w174) -> ("format"=w175, instance out=w176)
    Feedback Node(input=w177) -> w178
    call "802.11 RX IQ Processing.gcdl"(sample=w168, input valid=w169, packet start=w170, configuration=w178) -> (subcarrier=w179, subcarrier timing=w180, subcarrier field map=w181, last sample received=w182, channel estimate=w183, channel estimate timing=w184)
    Feedback Node(input=w185) -> w186
    call "802.11 RX Bit Processing.gcdl"(subcarrier timing=w180, subcarrier=w179, field map=w181, configuration=w186, noise coefficient=$"noise coefficient") -> (current OFDM symbol=w187, PSDU=w188, bit=w189, bit valid=w190, last byte decoded=w191, PSDU valid=w192)
    call "802.11 RX PHY State Machine.gcdl"(bit=w189, bit valid=w190, shared properties=w176, current OFDM symbol=w187, last bit of packet decoded=w191, last sample of packet received=w182, global timestamp=w136) -> (RX bit processing configuration=w185, RX IQ processing configuration=w177, PhyRxStart.ind=w193, PhyRxEnd.ind=w194)
    Property Node(instance in=w194) -> ("valid"=w166)
    Feedback Node(input=w195) -> w196
    To Fixed Point(number=w196) -> w197: FXP(10.3) Saturate:ConvergentRounding
    Select(s=$"enable AGC", t=w197, f=$"RF gain") -> w198
    call "802.11 Power Measurement.gcdl"(sample=w165, input valid=w163, CCA energy detect threshold=$"CCA energy detect threshold", power calibration offset=$"power calibration offset", RF gain=w198, sample 20MHz filtered=w162, sample 40MHz filtered=w164) -> (signal power=w199, output valid=w200, out of range?=w201, CCA energy detect=w202, RF input power=w203)
    Property Node(instance in=T22 {all zero or empty}, "CCA energy detection busy"=w202, "CCA signal detection busy"=w172) -> (instance out=w204)
    call "802.11 AGC.gcdl"(signal power=w199, packet start=w170, rearm AGC=w167, AGC thresholds=$"AGC tresholds", AGC timeout=$"AGC timeout", signal power valid=w200, enable AGC=$"enable AGC") -> (gain=w205, trigger gain setting=w206, state=w207, last applied gain=w195)
    Property Node(instance in=T24 {all zero or empty}, "trigger gain setting"=w206, "gain"=w205) -> (instance out=w208)
    w209 = cluster{"AGC state": T23, "AGC enabled": bool} {all zero or empty}
    Property Node(instance in=w209, "AGC state"=w207, "AGC enabled"=$"enable AGC") -> (instance out=w210)
    call "802.11 PHY-SAP Write PHY.gcdl"(PHY-SAP=w33, PSDU valid=w192, PSDU=w188, CCA detection=w204, PhyRxEnd.ind=w194, PhyRxStart.ind=w193, PhyTxEnd.ind=w157, PHY RX Gain change indication=w208, PHY RX AGC state indication=w210)
    call "802.11 Prepare RX IQ Data for T2H.gcdl"(subcarrier=w179, timing=w180, field map=w181, FIFO reference="802.11 AFW Resources.grsc\\T2H Constellation") -> (FIFO overflow count=w211)
    $"T2H Constallation overflow" <- w211
    call "802.11 Prepare Channel Estimation for T2H.gcdl"(channel estimate=w183, timing=w184, format=w175, FIFO reference="802.11 AFW Resources.grsc\\T2H Channel Estimation") -> (FIFO overflow count=w212)
    $"T2H Channel Estimation overflow" <- w212
    call "802.11 Trigger Capture RX Samples.gcdl"(trigger condition=$"trigger condition", manual trigger=$"manual trigger", RX packet start=w170, TX active register=w159, CCA energy detected=w202) -> (trigger=w213)
    call "802.11 Capture RX Samples.gcdl"(sample=w168, input valid=w169, trigger=w213, number of samples to capture=$"number of samples to capture", FIFO reference="802.11 AFW Resources.grsc\\T2H RX Power Spectrum", number of samples before trigger=$"number of samples before trigger") -> (FIFO overflow count=w214)
    $"T2H RX Power Spectrum overflow" <- w214
    call "802.11 TX Bit Processing.gcdl"(symbol trigger=w154, OFDM symbol index=w153, TX vector=w156, PSDU=w149, input valid=w150) -> (bit=w215, output valid=w216, ready for input=w147, modulation=w217)
    call "802.11 TX IQ Processing.gcdl"(symbol trigger=w154, OFDM symbol index=w153, TX vector=w156, channel selector=w146, start of packet=w155, bit valid=w216, bit=w215, bit processing modulation=w217, DC centered signal=w145, supported bandwidths=w144) -> (data out=w218, output valid=w219)
    call "802.11 TX Data Sink.gcdl"(TX to RF FIFO=w139, internal loopback FIFO=w138, sample=w218, input valid=w219, T2H FIFO="802.11 AFW Resources.grsc\\T2H TX Baseband") -> (T2H FIFO overflow count=w220, TX to RF FIFO overflow count=w221, internal loopback FIFO overflow count=w222)
    $"T2H TX Baseband FIFO overflow" <- w220
    $"TX to RF FIFO overflow" <- w221
    $"compensated CFO" <- w171
    $"internal loopback FIFO overflow" <- w222
    call "802.11 RX Bit Processing Data Sink.gcdl"(PSDU=w188, input valid=w192, FIFO reference="802.11 AFW Resources.grsc\\T2H RX Bit Processing Output") -> (FIFO overflow count=w223)
    $"T2H RX Bit Processing Output FIFO overflow" <- w223
    call "802.11 TX Bit Processing Data Sink.gcdl"(bit=w215, input valid=w216, modulation=w217, FIFO reference="802.11 AFW Resources.grsc\\T2H TX Bit Processing Output") -> (FIFO overflow count=w224)
    $"T2H TX Bit Processing Output FIFO overflow" <- w224
    call "802.11 Capture PHY RX Indications.gcdl"(PHY RX start indication in=w193, PHY RX end indication in=w194) -> (PHY RX start indication out=w225, PHY RX end indication out=w226)
    $"PhyRxStart.ind" <- w225
    $"PhyRxEnd.ind" <- w226
    $"RF input power" <- w203
    Feedback Node(enable?=w170, input=w203) -> w227
    $"RF input power at packet start" <- w227
    $"signal power" <- w199
    Feedback Node(enable?=w170, input=w199) -> w228
    $"signal power at packet start" <- w228
    $"out of range?" <- w201
    FIFO Write(Control Protocol Input=w206, data=w205, reference in=w140)
    $"last applied gain" <- w195
  }
  call "Create Resources.gvi"() -> (config.resources=w229, sync.resources=w230, time.resources=w231)
  clock-driven loop (clock = "40 MHz Onboard Clock") {
    Io Write(data=$"RF 1/Rx/Enable", reference in="RF 1/Rx/Enable")
    Io Write(data=$"RF 0/Tx/Enable", reference in="RF 0/Tx/Enable")
    Io Write(data=$"RF 0/Rx/Enable", reference in="RF 0/Rx/Enable")
    Feedback Node(input=w232) -> w233
    Property Node(instance in=w131) -> ("Gain Settings FIFO"=w234)
    FIFO Read(Control Protocol Input=TRUE, reference in=w234) -> (Control Protocol Output=w232, data=w235)
    Feedback Node(enable?=w232, input=w235) -> w236
    To Fixed Point(number=w236) -> w237: UFXP(6.1) Wrap:Truncate
    # Register Bus and Required Controls/Indicators
    Scale By Power Of 2(n=1, x=w237) -> w238
    To Unsigned Byte Integer(number=w238) -> w239
    Property Node(instance in=T2 {"power enable"=TRUE, "mixer enable"=TRUE, "gain"=0}, "power enable"=$"power enable", "mixer enable"=$"mixer enable", "gain"=w239) -> (instance out=w240)
    call "Set Gain.gcdl"(ATR State=$"ATR State", Radio Control Destination=$"Radio Control Destination", FPGA.Fifo="802.11 AFW Resources.grsc\\AGC Reg Bus 0 Access FIFO", daughterboard=$daughterboard, antenna configuration=$"antenna configuration", Write ATR?=w233, lo lpf enable=$"lo lpf enable", rx.configuration=w240, tx.configuration=$"tx.configuration", spi address=$"spi address", cpld enable=$"cpld enable")
    Io Write(data=$"RF 1/Tx/Enable", reference in="RF 1/Tx/Enable")
    Feedback Node(input=w241) -> w242
    Property Node(instance in=w242) -> ("ready for port 0 input"=w243, "ready for port 1 input"=w244)
    Feedback Node(input=w245) -> w246
    call "niInstr Register Bus v1 FPGA.lvlib__Process.gcdl"(reg.notify host.go rcvd=$"reg.notify host.go rcvd 0", reg.host read.go rcvd=$"reg.host read.go rcvd 0", read completion=w246, reg.reset=$"reg.reset 0", reg.host instruction fifo="niInstr Register Bus v0.grsc\\reg.host instruction fifo 0", ready for output=w244) -> (reg.notify host.go=w247, reg.host read.data=w248, register instruction=w249)
    $"reg.notify host.go 0" <- w247
    $"reg.host read.data 0" <- w248
    FIFO Read(Control Protocol Input=w243, reference in="802.11 AFW Resources.grsc\\AGC Reg Bus 0 Access FIFO") -> (Control Protocol Output=w250, data=w251)
    call "Retrieve FPGA Scoped Instruction.gcdl"(number=w251, valid=w250) -> (output cluster=w252)
    Feedback Node(input=w253) -> w254
    call "niInstr Register Bus v1 FPGA.lvlib__Register Instruction Arbiter (2 inputs).gcdl"(port 0=w252, port 1=w249, reset=FALSE, ready for output=w254) -> (register instr out=w255, ready for input=w241)
    call "Registers.gcdl"(register instruction=w255, config.resources=w229, sync.resources=w230, time.resources=w231) -> (read completion out=w245, ready for input=w253)
    stop if FALSE
  }
  clock-driven loop (clock = "Data Clock") forever {
    # Baseband to/from RF conversion
    # Data Reception from Antenna, downconversion to baseband sample rate, received data will be written into RX baseband input FIFO
    # Reading of TX baseband FIFO, upconversion and transmission to antenna
    Property Node(instance in=w21) -> ("shared properties"=w256, "global timestamp"=w257, "OFDM symbol pulse"=w258)
    call "Mod N Indexer U16 v2.gcdl"(N=$"Data clock cycles per tick (0.1us)", enable=$"data clock locked?") -> (wrap back?=w259)
    call "niInstr Basic Elements v1 FPGA.lvlib__Count Up U32.gcdl"(increment=w259, reset=FALSE) -> (count out=w260)
    Register Write(data=w260, reference in=w257)
    call "Mod N Indexer U16 v2.gcdl"(N=$"Data clock cycles per OFDM symbol", enable=$"data clock locked?") -> (wrap back?=w261)
    Register Write(data=w261, reference in=w258)
    w262 = T19 {"5 MHz"=FALSE, "10 MHz"=FALSE, "20 MHz"=TRUE, "40 MHz"=TRUE, "80 Mhz"=FALSE, "160 MHz"=FALSE}
    w263 = T20 {"format"="a", "channel selector"=0, "device MAC address"=[0, 0, 0, 0, 0, 0], "DC centered signal"=FALSE, "supported bandwidths"={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}}
    Property Node(instance in=w263, "format"=$format, "channel selector"=$"channel selector", "device MAC address"=$"device MAC address", "DC centered signal"=$"DC centered signal", "supported bandwidths"=w262) -> (instance out=w264)
    Register Write(data=w264, reference in=w256)
    $Timestamp <- w260
    Property Node(instance in=w131) -> ("TX to RF FIFO"=w265, "RF to RX FIFO"=w266)
    Build Array($"rx 0.stream enable", $"rx 1.stream enable") -> w267
    w268 = T26 {"0x800000000000", 0, 0, "0x1FFFF", "0x1FFFF", 0, 0, 0, 0, 0, 0, 0}
    Property Node(instance in=w268, "impairments"=$"rx 0.impairments", "frequency shift"=$"rx 0.frequency shift", "phase"=$"rx 0.phase", "output sample rate"=$"rx.output sample rate", "delay"=$"rx.delay") -> (instance out=w269)
    w270 = T26 {"0x800000000000", 0, 0, "0x1FFFF", "0x1FFFF", 0, 0, 0, 0, 0, 0, 0}
    Property Node(instance in=w270, "delay"=$"rx.delay", "output sample rate"=$"rx.output sample rate", "impairments"=$"rx 1.impairments", "frequency shift"=$"rx 1.frequency shift", "phase"=$"rx 1.phase") -> (instance out=w271)
    Build Array(w269, w271) -> w272
    call "802.11 USRP Stream RX.gcdl"(RF to RX FIFO reference=w266, enable DC offset correction=$"enable DC offset correction", rx.reset=$"rx.reset", rx.rf channel=$"rx.rf channel", rx. stream enabled=w267, rx.abort=$"rx.abort", DDC parameters=w272) -> (rx.number of IQ data overflows=w273, rx.dsp reset done=w274, DC average=w275, rx.state=w276, rx.samples processed=w277, rx.number of overflows=w278)
    $"rx.number of IQ data overflows" <- w273
    Build Array($"tx 0.stream enable", $"tx 1.stream enable") -> w279
    w280 = T27 {0, "0x1FFFF", "0x1FFFF", 0, 0, 0, 0, 0, 0, 0, 0, "0x200000", "0x200000", 0}
    Property Node(instance in=w280, "gain"=$"tx 0.gain", "frequency shift"=$"tx 0.frequency shift", "phase"=$"tx 0.phase", "impairments"=$"tx 0.impairments", "input sample rate"=$"tx.input sample rate", "delay"=$"tx.delay") -> (instance out=w281)
    w282 = T27 {0, "0x1FFFF", "0x1FFFF", 0, 0, 0, 0, 0, 0, 0, 0, "0x200000", "0x200000", 0}
    Property Node(instance in=w282, "delay"=$"tx.delay", "input sample rate"=$"tx.input sample rate", "gain"=$"tx 1.gain", "frequency shift"=$"tx 1.frequency shift", "phase"=$"tx 1.phase", "impairments"=$"tx 1.impairments") -> (instance out=w283)
    Build Array(w281, w283) -> w284
    call "802.11 USRP Stream TX.gcdl"(tx.enable streams=w279, tx.reset=$"tx.reset", tx.rf channel=$"tx.rf channel", TX to RF FIFO reference=w265, tx.abort=$"tx.abort", DUC parameters=w284) -> (tx.state=w285, tx.samples processed=w286, tx.underflows=w287, tx.number of IQ data overflows=w288, tx.dsp reset done=w289)
    $"tx.state" <- w285
    $"rx.dsp reset done" <- w274
    $"tx.samples processed" <- w286
    $"rx.state" <- w276
    $"tx.underflows" <- w287
    $"rx.samples processed" <- w277
    $"tx.number of IQ data overflows" <- w288
    $"rx.number of overflows" <- w278
    $"tx.dsp reset done" <- w289
    $"DC average" <- w275
  }
  call "LEDs.gvi"()
  call "niUsrpRio Config v1 FPGA.lvlib__Process.gvi"(resources=w229)
